# Grasshopper definition ScrewedTogetherFINAL.gh (Grasshopper 1.0.7)

width = Slider(2, range=0..100)
length = Slider(0.75, range=0..100)
# BRACKETS
height = Slider(1, range=0..1)
# BRACE
number_slider = Slider(0, range=0..100)
width_2 = Slider(3, range=0..100)
length_2 = Slider(3, range=0..100)
height_2 = Slider(0.75, range=0..1)
number_slider_2 = Slider(0, range=0..100)
# HOLES
radius = Slider(0.11, range=0..1)
vector_xyz = VectorXYZ(XComponent=Slider(1, range=0..10), YComponent=Slider(2, range=0..10), ZComponent=0)  # -> Vector, Length
construct_point = ConstructPoint(XCoordinate=width, YCoordinate=length, ZCoordinate=0)
construct_point_2 = ConstructPoint(XCoordinate=number_slider, YCoordinate=number_slider, ZCoordinate=number_slider)
cylinder = Cylinder(Base=PlaneXY(0, 0, 0), Radius=radius, Length=Slider(2, range=0..10))
construct_point_3 = ConstructPoint(XCoordinate=width_2, YCoordinate=length_2, ZCoordinate=0)
construct_point_4 = ConstructPoint(XCoordinate=number_slider_2, YCoordinate=number_slider_2, ZCoordinate=number_slider_2)
move = Move(Geometry=cylinder, Motion=vector_xyz.Vector)  # -> Geometry, Transform
rectangle_2pt = Rectangle2Pt(Plane=PlaneXY(0, 0, 0), PointA=construct_point_2, PointB=construct_point, Radius=0)  # -> Rectangle, Length
unit_z = UnitZ(Factor=height)
unit_z_2 = UnitZ(Factor=height_2)
rectangle_2pt_2 = Rectangle2Pt(Plane=PlaneXY(0, 0, 0), PointA=construct_point_4, PointB=construct_point_3, Radius=0)  # -> Rectangle, Length
unit_x = UnitX(Factor=Slider(1, range=0..1))
extrude = Extrude(Base=rectangle_2pt_2.Rectangle, Direction=unit_z_2)
extrude_2 = Extrude(Base=rectangle_2pt.Rectangle, Direction=unit_z)
move_2 = Move(Geometry=move.Geometry, Motion=unit_x)  # -> Geometry, Transform
pi = Pi(Factor=Slider(0.25, range=0..1))
pi_2 = Pi(Factor=Slider(0.5, range=0..1))
cap_holes = CapHoles(Brep=extrude_2)
yz_plane = YZPlane(Origin=Point(0, 0, 0))
yz_plane_2 = YZPlane(Origin=Point(0, 0, 0))
cap_holes_2 = CapHoles(Brep=extrude)
brep = Brep(cap_holes_2)
pi_3 = Pi(Factor=Slider(0.5, range=0..1))
yz_plane_3 = YZPlane(Origin=Point(0, 0, 0))
rotate = Rotate(Geometry=cap_holes, Angle=pi, Plane=yz_plane_2)  # -> Geometry, Transform
rotate_2 = Rotate(Geometry=brep, Angle=pi_2, Plane=yz_plane)  # -> Geometry, Transform
vector_xyz_2 = VectorXYZ(XComponent=Slider(0.5, range=0..1), YComponent=Slider(0.93, range=0..1), ZComponent=Slider(0.2, range=0..1))  # -> Vector, Length
rotate_3 = Rotate(Geometry=[move_2.Geometry, move.Geometry], Angle=pi_3, Plane=yz_plane_3)  # -> Geometry, Transform
unit_y = UnitY(Factor=Slider(0.75, range=0..10))
move_3 = Move(Geometry=rotate.Geometry, Motion=vector_xyz_2.Vector)  # -> Geometry, Transform
unit_y_2 = UnitY(Factor=Slider(0.84, range=0..10))
move_4 = Move(Geometry=rotate_2.Geometry, Motion=unit_y)  # -> Geometry, Transform
move_5 = Move(Geometry=rotate_3.Geometry, Motion=unit_y_2)  # -> Geometry, Transform
# BOOLEANS
solid_difference = SolidDifference(BrepsA=move_4.Geometry, BrepsB=move_5.Geometry)
solid_difference_2 = SolidDifference(BrepsA=brep, BrepsB=[move.Geometry, move_2.Geometry])
solid_union = SolidUnion(Breps=[solid_difference_2, solid_difference, move_3.Geometry])
solid_difference_3 = SolidDifference(BrepsA=solid_union, BrepsB=rotate_2.Geometry)
